test file "TestManager"
  coverage: Decision, MCDC, Condition

suite "Test Suite Complete System"

  case "Baseline" [baseline]
    model MyTestModel, harness MyTestModel_Harness2
    pre-load callback:
      initModel;
    baseline "baseline1.mat": rel tol 0.001
      Insignal
      MyTestModel:1
      TooHigh

  case "Equivalence SIL" [equivalence]
    simulation 1:
      model MyTestModel, harness MyTestModel_Harness2
    simulation 2:
      model MyTestModel, harness MyTestModel_Harness2, mode Software-in-the-Loop (SIL)
    equivalence criteria
      Insignal
      Outsignal: rel tol 0.001
      TooHigh

  case "FullCoverageTest" [baseline]
    model MyTestModel, harness MyTestModel_sldvharness
    input "Test Case:1" from MyTestModel_sldvdata.mat (active)
    input "Design Verifier (MyTestModel_sldvdata.mat)" from MyTestModel_sldvdata.mat
    iterations:
      Iteration1: ExternalInput "Test Case:1"